# Dynamo graph Adding OTL data to Object Items.dyn (Dynamo 2.3.0.5885)

file_path = Filename("C:\Users\910196\Downloads\Model Validation\Concepts_Properties.xlsx")
file_from_path = FileObject(path=file_path)
code_block = CodeBlock { "Bridge_Foundation"; false; }
importExcel = Data.ImportExcel(file=file_from_path, sheetName=code_block.out0, readAsStrings=code_block.out1, showExcel=code_block.out1)
code_block_2 = CodeBlock(data=importExcel)
# ---------- code_block_2.designscript (11 lines) ----------
//process excel data//
dropped = DSCore.List.DropItems(data, 1);
data_t = DSCore.List.Transpose(dropped);

//values for SP node//
sp_names = data_t[0];
sp_grps = data_t[1];
p_types = data_t[2];
p_BIpgs = data_t[4];
p_inst = data_t[5] == "Yes";
p_rept = data_t[6] == "Yes";
# ----------------------------------------
createSharedParameter = Parameter.CreateSharedParameter(parameterName=code_block_2.sp_names, groupName=code_block_2.sp_grps, type=code_block_2.p_types, group=code_block_2.p_BIpgs, instance=code_block_2.p_inst)  # unwired: categoryList
