# Dynamo graph REQ002.dyn "REQ001" (Dynamo 2.3.0.5885)
# packages: WombatDynamo 2.3.4

# group: Requirement Statement
object_name = StringInput("Bridge_Columns")  # graph input
parameter_name = StringInput("Design_Life")  # graph input
parameter_value = DoubleInput(100)  # graph input

# group: Data Processing
byName = Family.ByName(name=object_name)
types = Family.Types(family=byName)
all_elements_of_family_type = ElementsOfFamilyType(Family_Type=types)
getType = WombatDynamo.Element.GetType(element=all_elements_of_family_type)
parameterByName = Parameter.ParameterByName(element=getType, name=parameter_name)
value = Parameter.Value(parameter=parameterByName)
eq = value == parameter_value

# group: Compliance Result
requirement_compliance_yes_no = Watch(eq)  # graph output

# group: Requirement & Constraint
requirement = StringInput("REQ001: Structure shall have a design life of at least 100 years in the case of new non-replaceable structural components.")  # graph input
constraint = StringInput("""(Object:Bridge_Foundation AND Object:Bridge_Column AND Object: Bridge_Girder)

 HAS Property: Design_Life Value:100 Years
""")  # graph input

# group: Requirement Statement
string = StringInput("Bridge_Foundation")
string_2 = StringInput("Design_Life")
parameter_value_2 = DoubleInput(100)
string_3 = StringInput("Bridge_Columns")
string_4 = StringInput("Bridge_Girder")

# group: Data Processing
paramValueComparsion = Custom[ParamValueComparsion](Object_Name=string, Parameter_Name=string_2, Comparing_Value=parameter_value_2)  # Compares the value of the parameter with the input value
paramValueComparsion_2 = Custom[ParamValueComparsion](Object_Name=string_3, Parameter_Name=string_2, Comparing_Value=parameter_value_2)
paramValueComparsion_3 = Custom[ParamValueComparsion](Object_Name=string_4, Parameter_Name=string_2, Comparing_Value=parameter_value_2)
and_ = And(bool0=paramValueComparsion, bool1=paramValueComparsion_2, bool2=paramValueComparsion_3)

watch = Watch(and_)

# group: Requirement & Constraint
requirement_2 = StringInput("REQ001: Structure shall have a design life of at least 100 years in the case of new non-replaceable structural components.")
constraint_2 = StringInput("""(Object:Bridge_Foundation AND Object:Bridge_Column AND Object: Bridge_Girder)

 HAS Property: Design_Life Value:100 Years
""")
