# Dynamo graph REQ007.dyn (Dynamo 2.3.0.5885)
# packages: WombatDynamo 2.3.4

requirement = StringInput("""REQ007:
Structure shall provide space for an inspection path of at least 500 mm wide behind vehicle barriers and along the side verges and 2,200 mm in height
""")  # graph input
constraint = StringInput("""object:Bridge_Pedestrian Path HAS property:width == value:0.5m

AND

Object: Bridge_Railings HAS property:length == 2.2m
""")  # graph input

# group: Requirement Statement
object_name_1 = StringInput("Bridge_Pedestrian Path")
parameter_name_1 = StringInput("Width")
value_1 = DoubleInput(0.5)

code_block = CodeBlock { 0; }

# group: Requirement Statement
object_name_2 = StringInput("Bridge_Railings")
parameter_name_2 = StringInput("Length")
value_2 = DoubleInput(2.2)

# group: Data ProcessingBridge_Girder
byName = Family.ByName(name=object_name_1)
types = Family.Types(family=byName)
all_elements_of_family_type = ElementsOfFamilyType(Family_Type=types)
getType = WombatDynamo.Element.GetType(element=all_elements_of_family_type)
parameterByName = Parameter.ParameterByName(element=getType, name=parameter_name_1)
value = Parameter.Value(parameter=parameterByName)
byName_2 = Family.ByName(name=object_name_2)
types_2 = Family.Types(family=byName_2)
all_elements_of_family_type_2 = ElementsOfFamilyType(Family_Type=types_2)
getType_2 = WombatDynamo.Element.GetType(element=all_elements_of_family_type_2)
parameterByName_2 = Parameter.ParameterByName(element=getType_2, name=parameter_name_2)
value_3 = Parameter.Value(parameter=parameterByName_2)

flatten = List.Flatten(list=value)
getItemAtIndex = List.GetItemAtIndex(list=flatten, index=code_block)
ge = getItemAtIndex >= value_1
flatten_2 = List.Flatten(list=value_3)
code_block_2 = CodeBlock { 0; }
getItemAtIndex_2 = List.GetItemAtIndex(list=flatten_2, index=code_block_2)
eq = getItemAtIndex_2 == value_2

# group (continued): Data ProcessingBridge_Girder
and_ = And(bool0=ge, bool1=eq)

# group: Compliance Result
requirement_compliance = Watch(and_)  # graph output

requirement_2 = StringInput("""REQ007:
Structure shall provide space for an inspection path of at least 500 mm wide behind vehicle barriers and along the side verges and 2,200 mm in height
""")
constraint_2 = StringInput("""object:Bridge_Pedestrian Path HAS property:width == value:0.5m

AND

Object: Bridge_Railings HAS property:length == 2.2m
""")

# group: Requirement Statement
string = StringInput("Bridge_Pedestrian Path")
string_2 = StringInput("Width")
code_block_3 = CodeBlock { 0.5; }

# group: Requirement Statement
string_3 = StringInput("Bridge_Railings")
string_4 = StringInput("Length")
code_block_4 = CodeBlock { 2.2; }

# group: Data Processing
paramValueComparsion = Custom[ParamValueComparsion](Object_Name=string, Parameter_Name=string_2, Comparing_Value=code_block_3)  # Compares the value of the parameter with the input value
paramValueComparsion_2 = Custom[ParamValueComparsion](Object_Name=string_3, Parameter_Name=string_4, Comparing_Value=code_block_4)
and_2 = And(bool0=paramValueComparsion, bool1=paramValueComparsion_2)

# group: Compliance Result
requirement_compliance_2 = Watch(and_2)
