# Dynamo graph REQ010.dyn (Dynamo 2.3.0.5885)
# packages: WombatDynamo 2.3.4

# group: Requirement & Constraint
requirement = StringInput("REQ010: Non replaceable structures shall be inspectable constructively using non destructive methods.")  # graph input
constraint = StringInput("""(Bridge_Foundation AND Bridge_Columns AND Bridge_Girder)

HAS Property: Structural_Testing_Data Upload: Document""")  # graph input

# group: Requirement Statement
object_name = StringInput("Bridge_Columns")  # graph input
parameter_name = StringInput("Structural_Testing_Data")
file_path = Filename("C:\Users\910196\Downloads\TA Case Preference.xlsx")  # graph input

# group: Data Processing
byName = Family.ByName(name=object_name)
types = Family.Types(family=byName)
all_elements_of_family_type = ElementsOfFamilyType(Family_Type=types)
getType = WombatDynamo.Element.GetType(element=all_elements_of_family_type)
setParameterByName = Element.SetParameterByName(element=getType, parameterName=parameter_name, value=file_path)
string = StringInput("File path updated")
string_2 = StringInput("File path not updated")
if_ = If(test=setParameterByName, true=string, false=string_2)

# group: Compliance Result
requirement_compliance = Watch(if_)  # graph output

# group: Data Processing
setParameterValueByName = Custom[SetParameterValueByName](Element_Name=object_name, Parameter_Name=parameter_name, Parameter_Value=file_path)
