# Dynamo graph REQ013.dyn (Dynamo 2.3.0.5885)

requirement = StringInput("""REQ013:
The bike path and pedestrian path are at the same height and / or in sight of each other.
""")  # graph input
constraint = StringInput("""Object: Bridge_Slab HAS Property:top_height  SUBTRACT Property:bottom_height
Operator:==
Object:Bridge_Pedestrian Path HAS Property:top_height SUBTRACT Property:bottom height
""")  # graph input

# group: Requirement Statement
parameter_name_1 = StringInput("Top_Height")
object_name_1 = StringInput("Bridge_Slab")
parameter_name_2 = StringInput("Bottom_Height")
parameter_name_1_2 = StringInput("Top_Height")
object_name_1_2 = StringInput("Bridge_Pedestrian Path")
parameter_name_2_2 = StringInput("Bottom_Height")

# group: Data Processing
valueByObjNameParamName = Custom[ValueByObjNameParamName](Parameter_Name=parameter_name_1, Object_Name=object_name_1)
valueByObjNameParamName_2 = Custom[ValueByObjNameParamName](Parameter_Name=parameter_name_2, Object_Name=object_name_1)
sub = valueByObjNameParamName - valueByObjNameParamName_2
valueByObjNameParamName_3 = Custom[ValueByObjNameParamName](Parameter_Name=parameter_name_1_2, Object_Name=object_name_1_2)
valueByObjNameParamName_4 = Custom[ValueByObjNameParamName](Parameter_Name=parameter_name_2_2, Object_Name=object_name_1_2)
sub_2 = valueByObjNameParamName_3 - valueByObjNameParamName_4
sub_3 = sub - sub_2
code_block = CodeBlock { 0.1; }
le = sub_3 <= code_block

# group: Compliance Result
requirement_compliance = Watch(le)  # graph output
