# Dynamo graph REQ035.dyn (Dynamo 2.3.0.5885)
# packages: WombatDynamo 2.3.4

# group: Requirement & Constraint
requirement = StringInput("REQ035: Columns for structures shall be positioned in an equal and continuous line of the existing work.")  # graph input
constraint = StringInput("""FOR
 Bridge_Columns HAS property:work plane operator:= value:90""")  # graph input

# group: Requirement Statement
object_name = StringInput("Bridge_Columns")
parameter_name = StringInput("Workplane")
parameter_value = DoubleInput(90)

# group: Data Processing
byName = Family.ByName(name=object_name)
types = Family.Types(family=byName)
all_elements_of_family_type = ElementsOfFamilyType(Family_Type=types)
getType = WombatDynamo.Element.GetType(element=all_elements_of_family_type)
parameterByName = Parameter.ParameterByName(element=getType, name=parameter_name)
value = Parameter.Value(parameter=parameterByName)
eq = value == parameter_value

# group: Compliance Result
requirement_compliance_yes_no = Watch(eq)  # graph output
