# Dynamo graph REQ041.dyn (Dynamo 2.3.0.5885)
# packages: WombatDynamo 2.3.4

# group: Requirement & Constraint
requirement = StringInput("REQ041: The pedestrian and roadway shall be so constructed and  arranged that pedestrians are clearly visible to cyclists.")  # graph input
constraint = StringInput("""
Bridge_Columns HAS property:Level 

operator:== 

FOR (Bridge_Slab HAS property:Level)""")  # graph input

# group: Requirement Statement
object_name = StringInput("Bridge_Pedestrian Path")
parameter_name = StringInput("Level")

# group: Requirement Statement
object_name_2 = StringInput("Bridge_Slab")
parameter_name_2 = StringInput("Level")

# group: Data Processing
byName = Family.ByName(name=object_name)
types = Family.Types(family=byName)
all_elements_of_family_type = ElementsOfFamilyType(Family_Type=types)
getType = WombatDynamo.Element.GetType(element=all_elements_of_family_type)
parameterByName = Parameter.ParameterByName(element=getType, name=parameter_name)
value = Parameter.Value(parameter=parameterByName)
byName_2 = Family.ByName(name=object_name_2)
types_2 = Family.Types(family=byName_2)
all_elements_of_family_type_2 = ElementsOfFamilyType(Family_Type=types_2)
getType_2 = WombatDynamo.Element.GetType(element=all_elements_of_family_type_2)
parameterByName_2 = Parameter.ParameterByName(element=getType_2, name=parameter_name_2)
value_2 = Parameter.Value(parameter=parameterByName_2)
eq = value == value_2

# group: Compliance Result
requirement_compliance_yes_no = Watch(eq)  # graph output
